# Dynamo graph 99_Tests.dyn (Dynamo 1.0.0.1126)

number_slider = DoubleSlider(100, range=0..1000 step 0.1)
speedTo = BRobot_for_Dynamo.BRobot_for_Dynamo.SpeedTo(number_slider)
number_slider_2 = DoubleSlider(302, range=0..1000 step 0.1)
number_slider_3 = DoubleSlider(0, range=0..1000 step 0.1)
number_slider_4 = DoubleSlider(558, range=0..1000 step 0.1)
byCoordinates = Point.ByCoordinates(x=number_slider_2, y=number_slider_3, z=number_slider_4)
moveTo = BRobot_for_Dynamo.BRobot_for_Dynamo.MoveTo(byCoordinates)
number_slider_5 = DoubleSlider(100, range=0..1000 step 0.1)
number_slider_6 = DoubleSlider(0, range=0..1000 step 0.1)
number_slider_7 = DoubleSlider(50, range=0..1000 step 0.1)
byCoordinates_2 = Vector.ByCoordinates(x=number_slider_5, y=number_slider_6, z=number_slider_7)
move = BRobot_for_Dynamo.BRobot_for_Dynamo.Move(byCoordinates_2)
join = List.Join(speedTo, moveTo, move)
readProgram = BRobot_for_Dynamo.BRobot_for_Dynamo.ReadProgram(join)
newRobot = BRobot_for_Dynamo.BRobot_for_Dynamo.NewRobot()
generateCode = BRobot_for_Dynamo.BRobot_for_Dynamo.GenerateCode(newRobot, join)
