# Dynamo graph 01_HelloWorld.dyn (Dynamo 1.3.0.862)

# group: Create a simple action
code_block = CodeBlock { "Hello World!"; }
message = MachinaDynamo.Actions.Message(code_block)

# group: Use Machina to export a Program with that action
code_block_2 = CodeBlock { "MyFirstRobot"; "ABB"; }
create = MachinaDynamo.Robots.Create(code_block_2.out0, code_block_2.out1)
boolean = BoolSelector(true)
boolean_2 = BoolSelector(true)
compile = MachinaDynamo.Programs.Compile(create, message, boolean, boolean_2)
watch = Watch(compile)
