# Dynamo graph 03_SimpleProgram_VerticalSquare.dyn (Dynamo 1.3.0.862)

# group: Set initial Speed
number_slider = DoubleSlider(100, range=0..100 step 0.1)
speedTo = MachinaDynamo.Actions.SpeedTo(number_slider)

# group: Set initial target Precision
number_slider_2 = DoubleSlider(5, range=0..100 step 0.1)
precisionTo = MachinaDynamo.Actions.PrecisionTo(number_slider_2)

# group: Change to "joint" motion type
code_block = CodeBlock { "joint"; }
motionMode = MachinaDynamo.Actions.MotionMode(code_block)

# group: Move to base plane
number_slider_3 = DoubleSlider(400, range=-500..500 step 1)
number_slider_4 = DoubleSlider(200, range=-500..500 step 1)
number_slider_5 = DoubleSlider(500, range=-500..500 step 1)
byCoordinates = Point.ByCoordinates(x=number_slider_3, y=number_slider_4, z=number_slider_5)
XAxis = Vector.XAxis()
reverse = Vector.Reverse(XAxis)
YAxis = Vector.YAxis()
byOriginXAxisYAxis = Plane.ByOriginXAxisYAxis(byCoordinates, reverse, YAxis)
transformTo = MachinaDynamo.Actions.TransformTo(byOriginXAxisYAxis)

# group: Rotate robot flange around the Y Axis
YAxis_2 = Vector.YAxis()
number_slider_6 = DoubleSlider(-90, range=-180..180 step 0.1)
rotate = MachinaDynamo.Actions.Rotate(YAxis_2, number_slider_6)

# group: Wait before drawing the square
code_block_2 = CodeBlock { 1000; }
wait = MachinaDynamo.Actions.Wait(code_block_2)

# group: First part of the program: approaching the target and getting ready to 'draw'
create = List.Create(speedTo, precisionTo, motionMode, transformTo, rotate, wait)

# group: Draw the square slower, more precise and using linear movements
number_slider_7 = DoubleSlider(25, range=0..100 step 0.1)
speedTo_2 = MachinaDynamo.Actions.SpeedTo(number_slider_7)
number_slider_8 = DoubleSlider(1, range=0..100 step 0.1)
precisionTo_2 = MachinaDynamo.Actions.PrecisionTo(number_slider_8)
code_block_3 = CodeBlock { "linear"; }
motionMode_2 = MachinaDynamo.Actions.MotionMode(code_block_3)

# group: Trace a vertical square of side # mm using relative movements
number_slider_9 = DoubleSlider(75, range=0..100 step 0.1)
byCoordinates_2 = Vector.ByCoordinates(y=number_slider_9)
move = MachinaDynamo.Actions.Move(byCoordinates_2)
byCoordinates_3 = Vector.ByCoordinates(z=number_slider_9)
move_2 = MachinaDynamo.Actions.Move(byCoordinates_3)
code_block_4 = CodeBlock { -1; }
mul = number_slider_9 * code_block_4
byCoordinates_4 = Vector.ByCoordinates(y=mul)
move_3 = MachinaDynamo.Actions.Move(byCoordinates_4)
byCoordinates_5 = Vector.ByCoordinates(z=mul)
move_4 = MachinaDynamo.Actions.Move(byCoordinates_5)

# group: Wait before going back home
code_block_5 = CodeBlock { 2500; }
wait_2 = MachinaDynamo.Actions.Wait(code_block_5)

# group: Second part of the program: 'trace' a vertical square with relative motions.
create_2 = List.Create(speedTo_2, precisionTo_2, motionMode_2, move, move_2, move_3, move_4, wait_2)

# group: Speed things up again
number_slider_10 = DoubleSlider(100, range=0..100 step 0.1)
speedTo_3 = MachinaDynamo.Actions.SpeedTo(number_slider_10)
number_slider_11 = DoubleSlider(5, range=0..100 step 0.1)
precisionTo_3 = MachinaDynamo.Actions.PrecisionTo(number_slider_11)

# group: Go back to a 'home' position using joint rotation values directly
code_block_6 = CodeBlock { 0; 0; 0; 0; 90; 0; }
axesTo = MachinaDynamo.Actions.AxesTo(code_block_6.out0, code_block_6.out1, code_block_6.out2, code_block_6.out3, code_block_6.out4, code_block_6.out5)

# group: Third part: go back 'home' setting joint rotation values.
create_3 = List.Create(speedTo_3, precisionTo_3, axesTo)

# group: Combine program parts and flatten all the actions into a single Program
create_4 = List.Create(create, create_2, create_3)
flatten = Flatten(create_4)

# group: Compile the program into native code
code_block_7 = CodeBlock { "Tracer"; "ABB"; }
new = MachinaDynamo.Robots.Create(code_block_7.out0, code_block_7.out1)  # "Robots.New"
boolean = BoolSelector(true)
boolean_2 = BoolSelector(true)
compile = MachinaDynamo.Programs.Compile(new, flatten, boolean, boolean_2)

# group: Export it as a file on your system
code_block_8 = CodeBlock { "03_SimpleProgram_VerticalSquare.prg"; }
writeText = File.WriteText(code_block_8, compile)
watch = Watch(compile)

# group: Stream program in real-time to device via the Machina Bridge
# note: Check these tutorials on how to set up real-time control with your machine: https://www.youtube.com/playlist?list=PLvxxYImPCApXj3tHVKmpTS_AuMPngnA47
connect_to_bridge = BoolSelector(false)
connect = MachinaDynamo.Bridge.Connect(arg2=connect_to_bridge)
listen = MachinaDynamo.Bridge.Listen(connect.out1)
listen_to_only_most_recent = BoolSelector(true)  # "Listen to only most recent messages?"
actionExecuted = MachinaDynamo.Bridge.ActionExecuted(listen.out1, listen_to_only_most_recent)
watch_2 = Watch(actionExecuted.out1)
watch_3 = Watch(connect.out0)
watch_4 = Watch(listen.out0)
watch_5 = Watch(actionExecuted.out2)
send_actions_to_bridge = BoolSelector(false)
send = MachinaDynamo.Bridge.Send(connect.out1, flatten, send_actions_to_bridge)
watch_6 = Watch(send.out0)
watch_7 = Watch(actionExecuted.out5)
watch_8 = Watch(send.out1)
