# Dynamo graph 04_SimpleToolPath.dyn (Dynamo 1.3.0.862)

# group: Get curves from a DWG file
file_path = Filename(".\04_SimpleToolPath.dwg")
fromPath = Dynamo.Translation.FileLoader.FromPath(file_path)
getImportedObjects = Dynamo.Translation.FileLoader.GetImportedObjects(fromPath)
convertToGeometries = Dynamo.Translation.ImportedObject.ConvertToGeometries(getImportedObjects)
code_block = CodeBlock { 0; }
getItemAtIndex = List.GetItemAtIndex(list=convertToGeometries, index=code_block)

# group: Discretize curve into planes
number_slider = DoubleSlider(100, range=0..100 step 0.1)
pointsAtEqualSegmentLength = Curve.PointsAtEqualSegmentLength(curve=getItemAtIndex, divisions=number_slider)
# note: We flip the Planes to make it easier for the Robot to reach this orientation.
ZAxis = Vector.ZAxis()
reverse = Vector.Reverse(ZAxis)
startPoint = Curve.StartPoint(getItemAtIndex)
endPoint = Curve.EndPoint(getItemAtIndex)
create = List.Create(startPoint, pointsAtEqualSegmentLength, endPoint)
flatten = Flatten(create)
parameterAtPoint = Curve.ParameterAtPoint(curve=getItemAtIndex, point=flatten)
tangentAtParameter = Curve.TangentAtParameter(getItemAtIndex, parameterAtPoint)
byOriginNormalXAxis = Plane.ByOriginNormalXAxis(origin=pointsAtEqualSegmentLength, normal=reverse, xAxis=tangentAtParameter)

# group: Create individual actions
code_block_2 = CodeBlock { 100; }
speedTo = MachinaDynamo.Actions.SpeedTo(code_block_2)
code_block_3 = CodeBlock { 2; }
precisionTo = MachinaDynamo.Actions.PrecisionTo(code_block_3)
transformTo = MachinaDynamo.Actions.TransformTo(byOriginNormalXAxis)
code_block_4 = CodeBlock { 0; 0; 0; 0; 90; 0; }
axesTo = MachinaDynamo.Actions.AxesTo(code_block_4.out0, code_block_4.out1, code_block_4.out2, code_block_4.out3, code_block_4.out4, code_block_4.out5)

# group: Concatenate all Actions into a Program
create_2 = List.Create(speedTo, precisionTo, transformTo, axesTo)
flatten_2 = Flatten(create_2)

# group: Generate native code
code_block_5 = CodeBlock { "toolpather"; "ABB"; }
create_3 = MachinaDynamo.Robots.Create(code_block_5.out0, code_block_5.out1)
boolean = BoolSelector(true)
boolean_2 = BoolSelector(true)
compile = MachinaDynamo.Programs.Compile(create_3, flatten_2, boolean, boolean_2)

# group: Export it to a file
code_block_6 = CodeBlock { "04_SimpleToolPath.prg"; }
writeText = File.WriteText(code_block_6, compile)

# group: Stream program in real-time to device via the Machina Bridge
# note: Check these tutorials on how to set up real-time control with your machine: https://www.youtube.com/playlist?list=PLvxxYImPCApXj3tHVKmpTS_AuMPngnA47
connect_to_bridge = BoolSelector(false)
connect = MachinaDynamo.Bridge.Connect(arg2=connect_to_bridge)
watch = Watch(connect.out0)
listen = MachinaDynamo.Bridge.Listen(connect.out1)
watch_2 = Watch(listen.out0)
send_actions_to_bridge = BoolSelector(false)
send = MachinaDynamo.Bridge.Send(connect.out1, flatten_2, send_actions_to_bridge)
watch_3 = Watch(send.out0)
listen_to_only_most_recent = BoolSelector(true)  # "Listen to only most recent messages?"
actionExecuted = MachinaDynamo.Bridge.ActionExecuted(listen.out1, listen_to_only_most_recent)
watch_4 = Watch(actionExecuted.out5)
watch_5 = Watch(actionExecuted.out2)
watch_6 = Watch(send.out1)
watch_7 = Watch(actionExecuted.out1)
