# Dynamo graph 05_ToolChange.dyn (Dynamo 1.3.0.862)

# group: Create a Tool object representing a marker
code_block = CodeBlock { "marker"; }
XY = Plane.XY()
tool_length = DoubleSlider(150, range=0..150 step 0.1)
offset = Plane.Offset(XY, tool_length)

# group: Define the tool to be used in this program
defineTool = MachinaDynamo.Actions.DefineTool(code_block, XY, offset)

# group: Some starting definitions
create = List.Create(defineTool)

# group: Motion/program parameters
code_block_2 = CodeBlock()
# ---------- code_block_2.designscript (10 lines) ----------
travelSpeed = 100;
approachSpeed = 100;
traceSpeed = 25;

travelPrecision = 5;
approachPrecision = 3;
tracePrecision = 1;

attachWaitTime = 2500;
traceWaitTime = 1000;
# ----------------------------------------

# group: Set initial speed and precision and movement type
speedTo = MachinaDynamo.Actions.SpeedTo(code_block_2.travelSpeed)
precisionTo = MachinaDynamo.Actions.PrecisionTo(code_block_2.travelPrecision)
code_block_3 = CodeBlock { "joint"; }
motionMode = MachinaDynamo.Actions.MotionMode(code_block_3)

# group: Location of the tool tip
number_slider = DoubleSlider(300, range=-500..500 step 1)
number_slider_2 = DoubleSlider(-300, range=-500..500 step 1)
byCoordinates = Point.ByCoordinates(x=number_slider, y=number_slider_2)

# group: Location of tool base
translate = Geometry.Translate(geometry=byCoordinates, zTranslation=tool_length)

# group: Define an approach point above the marker
translate_2 = Geometry.Translate(geometry=translate, zTranslation=tool_length)

# group: Move to the approach point above the marker
moveTo = MachinaDynamo.Actions.MoveTo(translate_2)

# group: Slow down and approach the marker linearly
speedTo_2 = MachinaDynamo.Actions.SpeedTo(code_block_2.approachSpeed)
precisionTo_2 = MachinaDynamo.Actions.PrecisionTo(code_block_2.approachPrecision)
code_block_4 = CodeBlock { "linear"; }
motionMode_2 = MachinaDynamo.Actions.MotionMode(code_block_4)

# group: Move to the tool, attach it and wait a little
moveTo_2 = MachinaDynamo.Actions.MoveTo(translate)
attachTool = MachinaDynamo.Actions.AttachTool(code_block)
wait = MachinaDynamo.Actions.Wait(code_block_2.attachWaitTime)

# group: Move back to the approach point
moveTo_3 = MachinaDynamo.Actions.MoveTo(translate_2)

# group: Approach the tool and attach it
create_2 = List.Create(speedTo, precisionTo, motionMode, moveTo, speedTo_2, precisionTo_2, motionMode_2, moveTo_2, attachTool, wait, moveTo_3)

# group: Get curves from a DWG file
file_path = Filename(".\05_ToolChange.dwg")
fromPath = Dynamo.Translation.FileLoader.FromPath(file_path)
getImportedObjects = Dynamo.Translation.FileLoader.GetImportedObjects(fromPath)
convertToGeometries = Dynamo.Translation.ImportedObject.ConvertToGeometries(getImportedObjects)
code_block_5 = CodeBlock { 0; }
getItemAtIndex = List.GetItemAtIndex(list=convertToGeometries, index=code_block_5)

# group: Generate waypoints for toolpath
controlPoints = NurbsCurve.ControlPoints(getItemAtIndex)
firstItem = List.FirstItem(controlPoints)
number_slider_3 = DoubleSlider(25, range=0..100 step 0.1)
# note: Generate approach and retract points
translate_3 = Geometry.Translate(geometry=firstItem, zTranslation=number_slider_3)
lastItem = List.LastItem(controlPoints)
translate_4 = Geometry.Translate(geometry=lastItem, zTranslation=number_slider_3)

# group: Ramp up and approach toolpath entry point
code_block_6 = CodeBlock { "Now, let's draw!"; }
message = MachinaDynamo.Actions.Message(code_block_6)
speedTo_3 = MachinaDynamo.Actions.SpeedTo(code_block_2.travelSpeed)
precisionTo_3 = MachinaDynamo.Actions.PrecisionTo(code_block_2.travelPrecision)
code_block_7 = CodeBlock { "joint"; }
motionMode_3 = MachinaDynamo.Actions.MotionMode(code_block_7)
moveTo_4 = MachinaDynamo.Actions.MoveTo(translate_3)

# group: Slow down and trace all the points
speedTo_4 = MachinaDynamo.Actions.SpeedTo(code_block_2.traceSpeed)
precisionTo_4 = MachinaDynamo.Actions.PrecisionTo(code_block_2.tracePrecision)
code_block_8 = CodeBlock { "linear"; }
motionMode_4 = MachinaDynamo.Actions.MotionMode(code_block_8)
moveTo_5 = MachinaDynamo.Actions.MoveTo(controlPoints)

# group: Move to exit point and wait a little
moveTo_6 = MachinaDynamo.Actions.MoveTo(translate_4)
wait_2 = MachinaDynamo.Actions.Wait(code_block_2.traceWaitTime)

# group: Go to the toolpath and trace it with the marker
create_3 = List.Create(message, speedTo_3, precisionTo_3, motionMode_3, moveTo_4, speedTo_4, precisionTo_4, motionMode_4, moveTo_5, moveTo_6, wait_2)

# group: Speed up
code_block_9 = CodeBlock { "Housekeeping: put the tool back in place"; }
message_2 = MachinaDynamo.Actions.Message(code_block_9)
speedTo_5 = MachinaDynamo.Actions.SpeedTo(code_block_2.travelSpeed)
precisionTo_5 = MachinaDynamo.Actions.PrecisionTo(code_block_2.travelPrecision)

# group: Move to the approach point above the marker
moveTo_7 = MachinaDynamo.Actions.MoveTo(translate_2)

# group: Slow down and approach the marker drop position
speedTo_6 = MachinaDynamo.Actions.SpeedTo(code_block_2.approachSpeed)
precisionTo_6 = MachinaDynamo.Actions.PrecisionTo(code_block_2.approachPrecision)

# group: Move to the drop position and detach the tool
moveTo_8 = MachinaDynamo.Actions.MoveTo(byCoordinates)
detachTool = MachinaDynamo.Actions.DetachTool()
wait_3 = MachinaDynamo.Actions.Wait(code_block_2.attachWaitTime)

# group: Move back to the approach point
moveTo_9 = MachinaDynamo.Actions.MoveTo(translate_2)

# group: Go back to the tool holder and detach it
create_4 = List.Create(message_2, speedTo_5, precisionTo_5, moveTo_7, speedTo_6, precisionTo_6, moveTo_8, detachTool, wait_3, moveTo_9)

# group: Speed things up again and go back home
speedTo_7 = MachinaDynamo.Actions.SpeedTo(code_block_2.travelSpeed)
precisionTo_7 = MachinaDynamo.Actions.PrecisionTo(code_block_2.travelPrecision)
code_block_10 = CodeBlock { 0; 0; 0; 0; 90; 0; }
axesTo = MachinaDynamo.Actions.AxesTo(code_block_10.out0, code_block_10.out1, code_block_10.out2, code_block_10.out3, code_block_10.out4, code_block_10.out5)

# group: Go back home
create_5 = List.Create(speedTo_7, precisionTo_7, axesTo)

# group: Combine program parts and flatten all the actions into a single Program
create_6 = List.Create(create, create_2, create_3, create_4, create_5)
flatten = Flatten(create_6)

# group: Compile the program into native code
code_block_11 = CodeBlock { "Tracer"; "ABB"; }
create_7 = MachinaDynamo.Robots.Create(code_block_11.out0, code_block_11.out1)
boolean = BoolSelector(true)
boolean_2 = BoolSelector(true)
compile = MachinaDynamo.Programs.Compile(create_7, flatten, boolean, boolean_2)

# group: Export it as a file on your system
code_block_12 = CodeBlock { "05_ToolChange.prg"; }
writeText = File.WriteText(code_block_12, compile)
watch = Watch(compile)

# group: Welcome message
code_block_13 = CodeBlock { "Let's grab the marker!"; }
message_3 = MachinaDynamo.Actions.Message(code_block_13)

# group: Stream program in real-time to device via the Machina Bridge
# note: Check these tutorials on how to set up real-time control with your machine: https://www.youtube.com/playlist?list=PLvxxYImPCApXj3tHVKmpTS_AuMPngnA47
connect_to_bridge = BoolSelector(false)
connect = MachinaDynamo.Bridge.Connect(arg2=connect_to_bridge)
listen = MachinaDynamo.Bridge.Listen(connect.out1)
watch_2 = Watch(listen.out0)
send_actions_to_bridge = BoolSelector(false)
send = MachinaDynamo.Bridge.Send(connect.out1, flatten, send_actions_to_bridge)
watch_3 = Watch(send.out0)
watch_4 = Watch(send.out1)
watch_5 = Watch(connect.out0)
listen_to_only_most_recent = BoolSelector(true)  # "Listen to only most recent messages?"
actionExecuted = MachinaDynamo.Bridge.ActionExecuted(listen.out1, listen_to_only_most_recent)
watch_6 = Watch(actionExecuted.out5)
watch_7 = Watch(actionExecuted.out2)
watch_8 = Watch(actionExecuted.out1)
