# Dynamo graph 06_SurfaceMilling.dyn (Dynamo 1.3.0.862)

# group: Program Settings
zone = IntegerSlider(2, range=0..100 step 1)
travelSpeed = IntegerSlider(200, range=0..200 step 1)
leadDistance = IntegerSlider(-50, range=-150..200 step 1)
leadSpeed = IntegerSlider(75, range=0..200 step 1)
millSpeed = IntegerSlider(25, range=0..200 step 1)
waittime_between_paths = IntegerSlider(1000, range=0..2500 step 1)

# group: Create a tool for the robot
code_block = CodeBlock { "MillingBit"; 100; }
XY = Plane.XY()
offset = Plane.Offset(XY, code_block.out1)

# group: Define and use this tool through the program
defineTool = MachinaDynamo.Actions.DefineTool(code_block.out0, XY, offset)
attachTool = MachinaDynamo.Actions.AttachTool(code_block.out0)

# group: Plane properties
planes_in_u = IntegerSlider(10, range=0..30 step 1)
planes_in_v = IntegerSlider(10, range=0..30 step 1)

# group: Surface parameters
baseX = DoubleSlider(400, range=-500..500 step 0.1)
width = DoubleSlider(150, range=0..200 step 0.1)
u_control_points = IntegerSlider(4, range=0..10 step 1)
baseY = DoubleSlider(100, range=-500..500 step 0.1)
length = DoubleSlider(150, range=0..200 step 0.1)
v_control_points = IntegerSlider(4, range=0..10 step 1)
baseZ = DoubleSlider(300, range=-500..500 step 0.1)
max_height = DoubleSlider(25, range=0..100 step 0.1)

# group: Surface generation
code_block_2 = CodeBlock { 1; }
sub = u_control_points - code_block_2
div = code_block_2 / sub
range = Range(end=code_block_2, step=div, lacing=Longest)
mul = width * range
watch = Watch(mul)
add = baseX + watch
sub_2 = v_control_points - code_block_2
div_2 = code_block_2 / sub_2
range_2 = Range(end=code_block_2, step=div_2, lacing=Longest)
mul_2 = length * range_2
watch_2 = Watch(mul_2)
add_2 = baseY + watch_2
byCoordinates = Point.ByCoordinates(x=add, y=add_2, lacing=CrossProduct)
flatten = Flatten(byCoordinates)
count = List.Count(flatten)
randomList = Math.RandomList(count)
mul_3 = randomList * max_height
count_2 = List.Count(range_2)

add_3 = baseZ + mul_3

# group (continued): Surface generation
byCoordinates_2 = Vector.ByCoordinates(z=add_3)
chop = List.Chop(list=byCoordinates_2, lengths=count_2)
add_4 = Point.Add(point=byCoordinates, vectorToAdd=chop)
byPoints = NurbsCurve.ByPoints(add_4)
byLoft = Surface.ByLoft(byPoints)

# group: Create planes
code_block_3 = CodeBlock(a=planes_in_u) { b = a - 1; }
range_3 = Range(end=code_block_3, lacing=Longest)
watch_3 = Watch(byLoft)
div_3 = range_3 / code_block_3
code_block_4 = CodeBlock(a=planes_in_v) { b = a - 1; }
range_4 = Range(end=code_block_4, lacing=Longest)
div_4 = range_4 / code_block_4
pointAtParameter = Surface.PointAtParameter(surface=watch_3, u=div_3, v=div_4, lacing=CrossProduct)
normalAtParameter = Surface.NormalAtParameter(surface=watch_3, u=div_3, v=div_4, lacing=CrossProduct)
byOriginNormal = Plane.ByOriginNormal(origin=pointAtParameter, normal=normalAtParameter)

# group: Generate lead-in planes
transpose = List.Transpose(byOriginNormal)
firstItem = List.FirstItem(transpose)
normal = Plane.Normal(firstItem)
scale = Vector.Scale(vector=normal, scale_factor=leadDistance)
translate = Geometry.Translate(geometry=firstItem, direction=scale)

code_block_5 = CodeBlock { 0; }
removeItemAtIndex = List.RemoveItemAtIndex(list=transpose, indices=code_block_5)

# group: Generate lead-out vectors
lastItem = List.LastItem(transpose)
normal_2 = Plane.Normal(lastItem)
scale_2 = Vector.Scale(vector=normal_2, scale_factor=leadDistance)

# group: Prepare action data for each mill path
code_block_6 = CodeBlock(a=range_3) { b = "Starting Path #" + a; }
initit_message = Watch(code_block_6)
message = MachinaDynamo.Actions.Message(initit_message)
cycle = List.Cycle(list=travelSpeed, amount=planes_in_u)
travel_speed = Watch(cycle)
speedTo = MachinaDynamo.Actions.SpeedTo(travel_speed)
travel_target = Watch(translate)
transformTo = MachinaDynamo.Actions.TransformTo(travel_target)
cycle_2 = List.Cycle(list=leadSpeed, amount=planes_in_u)
lead_speed = Watch(cycle_2)
speedTo_2 = MachinaDynamo.Actions.SpeedTo(lead_speed)
lead_in_plane = Watch(firstItem)
transformTo_2 = MachinaDynamo.Actions.TransformTo(lead_in_plane)
cycle_3 = List.Cycle(list=millSpeed, amount=planes_in_u)
milling_speed = Watch(cycle_3)
speedTo_3 = MachinaDynamo.Actions.SpeedTo(milling_speed)
transpose_2 = List.Transpose(removeItemAtIndex)
rest_of_toolpath_planes = Watch(transpose_2)
transformTo_3 = MachinaDynamo.Actions.TransformTo(rest_of_toolpath_planes)
cycle_4 = List.Cycle(list=leadSpeed, amount=planes_in_u)
lead_speed_2 = Watch(cycle_4)
speedTo_4 = MachinaDynamo.Actions.SpeedTo(lead_speed_2)
lead_out_vector = Watch(scale_2)
move = MachinaDynamo.Actions.Move(lead_out_vector)
cycle_5 = List.Cycle(list=waittime_between_paths, amount=planes_in_u)
watch_4 = Watch(cycle_5)
wait = MachinaDynamo.Actions.Wait(watch_4)

# group: Back to 'home' position
code_block_7 = CodeBlock { 0; 90; }
axesTo = MachinaDynamo.Actions.AxesTo(code_block_7.out0, code_block_7.out0, code_block_7.out0, code_block_7.out0, code_block_7.out1, code_block_7.out0)

# group: Merge actions into a program
create = List.Create(defineTool, attachTool)
# note: Use a combinator to merge lists on a per-item basis
create_2 = List.Create()  # unwired: arg0, arg1, arg2, arg3, arg4, arg5, arg6, arg7, arg8, arg9
combine = List.Combine(create_2, message, speedTo, transformTo, speedTo_2, transformTo_2, speedTo_3, transformTo_3, speedTo_4, move, wait)
flatten_2 = Flatten(combine)
join = List.Join(create, flatten_2, axesTo)
watch_5 = Watch(combine)
watch_6 = Watch(join)

# group: Create an ABB Robot and compile these actions into a native program
code_block_8 = CodeBlock { "Miller"; "ABB"; }
create_3 = MachinaDynamo.Robots.Create(code_block_8.out0, code_block_8.out1)
boolean = BoolSelector(true)
compile = MachinaDynamo.Programs.Compile(create_3, join, boolean)
watch_7 = Watch(compile)

# group: Export the file to the system
code_block_9 = CodeBlock { "06_SurfaceMilling.prg"; }
writeText = File.WriteText(code_block_9, compile)

# group: Stream program in real-time to device via the Machina Bridge
# note: Check these tutorials on how to set up real-time control with your machine: https://www.youtube.com/playlist?list=PLvxxYImPCApXj3tHVKmpTS_AuMPngnA47
connect_to_bridge = BoolSelector(false)
connect = MachinaDynamo.Bridge.Connect(arg2=connect_to_bridge)
listen = MachinaDynamo.Bridge.Listen(connect.out1)
watch_8 = Watch(listen.out0)
send_actions_to_bridge = BoolSelector(false)
send = MachinaDynamo.Bridge.Send(connect.out1, join, send_actions_to_bridge)
watch_9 = Watch(send.out0)
watch_10 = Watch(send.out1)
watch_11 = Watch(connect.out0)
listen_to_only_most_recent = BoolSelector(true)  # "Listen to only most recent messages?"
actionExecuted = MachinaDynamo.Bridge.ActionExecuted(listen.out1, listen_to_only_most_recent)
watch_12 = Watch(actionExecuted.out5)
watch_13 = Watch(actionExecuted.out2)
watch_14 = Watch(actionExecuted.out1)
