# Dynamo graph 01_HelloWorld.dyn (Dynamo 1.1.0.2093)

# group: Create a simple action
code_block = CodeBlock { "Hello World!"; }
message = Machina.Actions.Message(code_block)

# group: Use Machina to export a Program with that action
code_block_2 = CodeBlock { "MyFirstRobot"; "ABB"; }
create = Machina.Robots.Create(code_block_2.out0, code_block_2.out1)
exportCode = Machina.Programs.ExportCode(create, message)

watch = Watch(exportCode)
