# Dynamo graph 02_SimpleProgram.dyn (Dynamo 1.1.0.2093)

# group: BRobot version
version = BRobot.BRobot.Version()

# group: Start message ;)
code_block = CodeBlock { "Let's do some BRobotics!"; }
message = BRobot.BRobot.Message(code_block)

# group: Set speed
number_slider = DoubleSlider(100, range=0..100 step 0.1)
speedTo = BRobot.BRobot.SpeedTo(number_slider)

# group: Move to Point
number_slider_2 = DoubleSlider(300, range=0..500 step 0.1)
number_slider_3 = DoubleSlider(200, range=0..500 step 0.1)
number_slider_4 = DoubleSlider(300, range=0..500 step 0.1)
byCoordinates = Point.ByCoordinates(x=number_slider_2, y=number_slider_3, z=number_slider_4)
moveTo = BRobot.BRobot.MoveTo(byCoordinates)

# group: Rotate around Y axis
YAxis = Vector.YAxis()
number_slider_5 = DoubleSlider(-90, range=-180..180 step 0.1)
rotate = BRobot.BRobot.Rotate(YAxis, number_slider_5)

# group: Slow down
number_slider_6 = DoubleSlider(-50, range=-50..50 step 0.1)
speed = BRobot.BRobot.Speed(number_slider_6)

# group: Move along vector
number_slider_7 = DoubleSlider(0, range=0..500 step 0.1)
number_slider_8 = DoubleSlider(0, range=0..500 step 0.1)
number_slider_9 = DoubleSlider(250, range=0..500 step 0.1)
byCoordinates_2 = Vector.ByCoordinates(x=number_slider_7, y=number_slider_8, z=number_slider_9)
move = BRobot.BRobot.Move(byCoordinates_2)

# group: Wait a bit before continuing
number_slider_10 = DoubleSlider(2500, range=0..5000 step 0.1)
wait = BRobot.BRobot.Wait(number_slider_10)

# group: Fast again
number_slider_11 = DoubleSlider(200, range=0..200 step 0.1)
speedTo_2 = BRobot.BRobot.SpeedTo(number_slider_11)

# group: Back to 'home' position
code_block_2 = CodeBlock { 0; 90; }
jointsTo = BRobot.BRobot.JointsTo(code_block_2.out0, code_block_2.out0, code_block_2.out0, code_block_2.out0, code_block_2.out1, code_block_2.out0)

# group: Merge actions into a list and display it
join = List.Join(message, speedTo, moveTo, rotate, speed, move, wait, speedTo_2, jointsTo)
watch = Watch(join)

# group: Export Code
code_block_3 = CodeBlock { "ABB"; }
create = BRobot.BRobot.Create(code_block_3)
exportCode = BRobot.BRobot.ExportCode(create, join)
code_block_4 = CodeBlock { "C:\DynamoBRobot.mod"; }
writeToFile = BRobot.BRobot.WriteToFile(exportCode, code_block_4)
watch_2 = Watch(writeToFile)
watch_3 = Watch(exportCode)
code_block_5 = CodeBlock()
# ---------- code_block_5.designscript (3 lines) ----------
"If you are getting error messages writing to a file,";
"Dynamo may not have permission to modify your system.";
"Try running Dynamo as Admin.";
# ----------------------------------------
