# Dynamo graph 04_SimpleToolPath.dyn (Dynamo 1.1.0.2093)

# group: Get curves from a DWG file
file_path = Filename(".\04_SimpleToolPath.dwg")
fromPath = Dynamo.Translation.FileLoader.FromPath(file_path)
getImportedObjects = Dynamo.Translation.FileLoader.GetImportedObjects(fromPath)
convertToGeometries = Dynamo.Translation.ImportedObject.ConvertToGeometries(getImportedObjects)
code_block = CodeBlock { 0; }
getItemAtIndex = List.GetItemAtIndex(list=convertToGeometries, index=code_block)

# group: Discretize curve into planes
number_slider = DoubleSlider(100, range=0..100 step 0.1)
pointsAtEqualSegmentLength = Curve.PointsAtEqualSegmentLength(curve=getItemAtIndex, divisions=number_slider)
# note: We flip the Planes to make it easier for the Robot to reach this orientation.
ZAxis = Vector.ZAxis()
reverse = Vector.Reverse(ZAxis)
startPoint = Curve.StartPoint(getItemAtIndex)
endPoint = Curve.EndPoint(getItemAtIndex)
create = List.Create(startPoint, pointsAtEqualSegmentLength, endPoint)
flatten = Flatten(create)
parameterAtPoint = Curve.ParameterAtPoint(curve=getItemAtIndex, point=flatten)
tangentAtParameter = Curve.TangentAtParameter(getItemAtIndex, parameterAtPoint)
byOriginNormalXAxis = Plane.ByOriginNormalXAxis(origin=pointsAtEqualSegmentLength, normal=reverse, xAxis=tangentAtParameter)

# group: Create individual actions
code_block_2 = CodeBlock { 100; }
speedTo = MachinaDynamo.Actions.SpeedTo(code_block_2)
code_block_3 = CodeBlock { 2; }
zoneTo = MachinaDynamo.Actions.ZoneTo(code_block_3)
transformTo = MachinaDynamo.Actions.TransformTo(byOriginNormalXAxis)
code_block_4 = CodeBlock { 0; 0; 0; 0; 90; 0; }
jointsTo = MachinaDynamo.Actions.JointsTo(code_block_4.out0, code_block_4.out1, code_block_4.out2, code_block_4.out3, code_block_4.out4, code_block_4.out5)

# group: Concatenate all Actions into a Program
create_2 = List.Create(speedTo, zoneTo, transformTo, jointsTo)
flatten_2 = Flatten(create_2)

# group: Generate native code
code_block_5 = CodeBlock { "toolpather"; "ABB"; }
create_3 = MachinaDynamo.Robots.Create(arg1=code_block_5.out1)
boolean = BoolSelector(true)
exportCode = MachinaDynamo.Programs.ExportCode(create_3, flatten_2, boolean)

# group: Export it to a file
file_path_2 = Filename(".\04_SimpleToolPath.prg")
writeText = File.WriteText(file_path_2, exportCode)
