# Dynamo graph 07_3DPrinting.dyn (Dynamo 1.3.0.862)

# group: 3D printing parameters
robot_parameters = CodeBlock { name = "PrinterArm"; brand = "ABB"; }
robot_io_parameters = CodeBlock { name = "extruderIO"; pin = 1; digitalPin = true; }
tool_parameters = CodeBlock { name = "extruderTool"; base = Plane.XY(); TCP = Plane.Offset(base, 100); weight = 5; }
travel_speed = DoubleSlider(100, range=0..100 step 1)
travel_precision = DoubleSlider(10, range=0..10 step 1)
print_speed = DoubleSlider(25, range=0..100 step 1)
print_precision = DoubleSlider(1, range=0..10 step 1)

# group: Robot Creation
create = MachinaDynamo.Robots.Create(robot_parameters.name, robot_parameters.brand)
setIOName = MachinaDynamo.Robots.SetIOName(create, robot_io_parameters.name, robot_io_parameters.pin, robot_io_parameters.digitalPin)

# group: Tool definition
create_2 = MachinaDynamo.Tools.Create(tool_parameters.name, tool_parameters.base, tool_parameters.TCP, tool_parameters.weight)

# group: Geometry parameters
baseX = DoubleSlider(500, range=-500..500 step 1)
baseY = DoubleSlider(200, range=-500..500 step 1)
baseZ = DoubleSlider(100, range=-500..500 step 1)
base_diameter = DoubleSlider(100, range=0..300 step 1)
height = DoubleSlider(50, range=0..300 step 1)
layerHeight = DoubleSlider(2.5, range=0..25 step 0.01)
print_definition_points_per = DoubleSlider(100, range=0..300 step 1)  # "Print definition: points per layer"

# group: Generate geometry and wayplanes
code_block = CodeBlock(x=baseX, y=baseY, z=baseZ, diameter=base_diameter, height=height, layerHeight=layerHeight, layerDefinition=print_definition_points_per)
# ---------- code_block.designscript (35 lines) ----------
x;
y;
z;
diameter;
height;
layerHeight;
layerDefinition;

// Generate some aux geometry
basePoint = Point.ByCoordinates(x, y, z);
basePlane = Plane.ByOriginNormal(basePoint, Vector.ZAxis());
offsetPlane = Plane.Offset(basePlane, height);

// Create loft curves and combine them into a list
rectangle = Rectangle.ByWidthLength(basePlane, diameter, diameter);
circle = Circle.ByPlaneRadius(offsetPlane, 0.5 * diameter);
curves = {rectangle, circle};

// Loft surface
surface = Surface.ByLoft(curves);

// Create section planes and curves
sectionCount = 1 + height / layerHeight;
offsetDistances = {0..height..#sectionCount};
sectionPlanes = Plane.Offset(basePlane, offsetDistances);
sectionCurves = Geometry.Intersect(surface, sectionPlanes);
sectionCurvesJoint = PolyCurve.ByJoinedCurves(sectionCurves);

// Divide curves into points and generate target planes
curveParameter = {0..1..#layerDefinition};
wayPoints = Curve.PointAtParameter(sectionCurvesJoint<1><1>, curveParameter<1><2>);
// Create planes whose orientation matches the robot's flange pointing down
xVec = Vector.Reverse(Vector.XAxis());
zVec = Vector.Reverse(Vector.ZAxis());
wayPlanes = Plane.ByOriginNormalXAxis(wayPoints, zVec, xVec);
# ----------------------------------------

flatten = Flatten(code_block.wayPlanes)

# group: Travel to start point
attach = MachinaDynamo.Actions.Attach(create_2)
speedTo = MachinaDynamo.Actions.SpeedTo(travel_speed)
precisionTo = MachinaDynamo.Actions.PrecisionTo(travel_precision)
firstItem = List.FirstItem(flatten)
transformTo = MachinaDynamo.Actions.TransformTo(firstItem)

# group: Slow down
speedTo_2 = MachinaDynamo.Actions.SpeedTo(print_speed)
precisionTo_2 = MachinaDynamo.Actions.PrecisionTo(print_precision)

# group: Start extruding
code_block_2 = CodeBlock { true; }
writeDigital = MachinaDynamo.Actions.WriteDigital(robot_io_parameters.pin, code_block_2)

# group: Go through all the wayPlanes
transformTo_2 = MachinaDynamo.Actions.TransformTo(flatten)

# group: Stop extruding
code_block_3 = CodeBlock { false; }
writeDigital_2 = MachinaDynamo.Actions.WriteDigital(robot_io_parameters.pin, code_block_3)

# group: Back home
speedTo_3 = MachinaDynamo.Actions.SpeedTo(travel_speed)
precisionTo_3 = MachinaDynamo.Actions.PrecisionTo(travel_precision)
code_block_4 = CodeBlock()
# ---------- code_block_4.designscript (2 lines) ----------
// Actions can also be created through codeblocks
goHome = Actions.Axes(0, 0, 0, 0, 90, 00);
# ----------------------------------------

# group: Create program
create_3 = List.Create(attach, speedTo, precisionTo, transformTo, speedTo_2, precisionTo_2, writeDigital, transformTo_2, writeDigital_2, speedTo_3, precisionTo_3, code_block_4)
flatten_2 = Flatten(create_3)

boolean = BoolSelector(false)

# group: Compile these actions into a native program
boolean_2 = BoolSelector(true)
compileProgram = MachinaDynamo.Programs.CompileProgram(setIOName, flatten_2, boolean_2, boolean)
watch = Watch(compileProgram)

# group: Export the file to the system
code_block_5 = CodeBlock { "07_3DPrinting.prg"; }
writeText = File.WriteText(code_block_5, compileProgram)
