# Dynamo graph 01_HelloWorld.dyn (Dynamo 1.1.0.2093)

# group: Create a simple action
code_block = CodeBlock { "Hello World!"; }
message = BRobot.BRobot.Message(code_block)

# group: Use BRobot to create a program with that action
code_block_2 = CodeBlock { "ABB"; }
create = BRobot.BRobot.Create(code_block_2)
exportCode = BRobot.BRobot.ExportCode(create, message)
watch = Watch(exportCode)
