# Dynamo graph 03_SurfaceMilling.dyn (Dynamo 1.1.0.2093)

# group: Program Settings
zone = IntegerSlider(2, range=0..100 step 1)
travelSpeed = IntegerSlider(200, range=0..200 step 1)
leadDistance = IntegerSlider(-50, range=-150..200 step 1)
leadSpeed = IntegerSlider(75, range=0..200 step 1)
millSpeed = IntegerSlider(25, range=0..200 step 1)
waittime_between_paths = IntegerSlider(2500, range=0..2500 step 1)

# group: Plane properties
planes_in_u = IntegerSlider(5, range=0..30 step 1)
planes_in_v = IntegerSlider(5, range=0..30 step 1)

# group: Surface parameters
baseX = DoubleSlider(200, range=-500..500 step 0.1)
width = DoubleSlider(200, range=0..200 step 0.1)
u_control_points = IntegerSlider(3, range=0..10 step 1)
baseY = DoubleSlider(50, range=-500..500 step 0.1)
length = DoubleSlider(200, range=0..200 step 0.1)
v_control_points = IntegerSlider(3, range=0..10 step 1)
baseZ = DoubleSlider(300, range=-500..500 step 0.1)
max_height = DoubleSlider(46.7, range=0..100 step 0.1)

# group: Surface generation
code_block = CodeBlock { 1; }
sub = u_control_points - code_block
div = code_block / sub
range = Range(end=code_block, step=div, lacing=Longest)
mul = width * range
watch = Watch(mul)
add = baseX + watch
sub_2 = v_control_points - code_block
div_2 = code_block / sub_2
range_2 = Range(end=code_block, step=div_2, lacing=Longest)
mul_2 = length * range_2
watch_2 = Watch(mul_2)
add_2 = baseY + watch_2
byCoordinates = Point.ByCoordinates(x=add, y=add_2, lacing=CrossProduct)
flatten = Flatten(byCoordinates)
count = List.Count(flatten)
randomList = Math.RandomList(count)
mul_3 = randomList * max_height
count_2 = List.Count(range_2)

add_3 = baseZ + mul_3

# group (continued): Surface generation
byCoordinates_2 = Vector.ByCoordinates(z=add_3)
chop = List.Chop(list=byCoordinates_2, lengths=count_2)
add_4 = Point.Add(point=byCoordinates, vectorToAdd=chop)
byPoints = NurbsCurve.ByPoints(add_4)
byLoft = Surface.ByLoft(byPoints)

# group: Create planes
code_block_2 = CodeBlock(a=planes_in_u) { b = a - 1; }
range_3 = Range(end=code_block_2, lacing=Longest)
watch_3 = Watch(byLoft)
div_3 = range_3 / code_block_2
code_block_3 = CodeBlock(a=planes_in_v) { b = a - 1; }
range_4 = Range(end=code_block_3, lacing=Longest)
div_4 = range_4 / code_block_3
pointAtParameter = Surface.PointAtParameter(surface=watch_3, u=div_3, v=div_4, lacing=CrossProduct)
normalAtParameter = Surface.NormalAtParameter(surface=watch_3, u=div_3, v=div_4, lacing=CrossProduct)
byOriginNormal = Plane.ByOriginNormal(origin=pointAtParameter, normal=normalAtParameter)

# group: Generate lead-in planes
transpose = List.Transpose(byOriginNormal)
firstItem = List.FirstItem(transpose)
normal = Plane.Normal(firstItem)
scale = Vector.Scale(vector=normal, scale_factor=leadDistance)
translate = Geometry.Translate(geometry=firstItem, direction=scale)

code_block_4 = CodeBlock { 0; }
removeItemAtIndex = List.RemoveItemAtIndex(list=transpose, indices=code_block_4)

# group: Generate lead-out vectors
lastItem = List.LastItem(transpose)
normal_2 = Plane.Normal(lastItem)
scale_2 = Vector.Scale(vector=normal_2, scale_factor=leadDistance)

# group: Prepare action data
code_block_5 = CodeBlock(a=range_3) { b = "Starting Path #" + a; }
initit_message = Watch(code_block_5)
cycle = List.Cycle(list=travelSpeed, amount=planes_in_u)
travel_speed = Watch(cycle)
travel_target = Watch(translate)
cycle_2 = List.Cycle(list=leadSpeed, amount=planes_in_u)
lead_speed = Watch(cycle_2)
lead_in_plane = Watch(firstItem)
cycle_3 = List.Cycle(list=millSpeed, amount=planes_in_u)
milling_speed = Watch(cycle_3)
transpose_2 = List.Transpose(removeItemAtIndex)
rest_of_toolpath_planes = Watch(transpose_2)
cycle_4 = List.Cycle(list=leadSpeed, amount=planes_in_u)
lead_speed_2 = Watch(cycle_4)
lead_out_vector = Watch(scale_2)
cycle_5 = List.Cycle(list=waittime_between_paths, amount=planes_in_u)
watch_4 = Watch(cycle_5)

# group: Generate, merge and flatten actions
create = List.Create()
message = BRobot.BRobot.Message(initit_message)
speedTo = BRobot.BRobot.SpeedTo(travel_speed)
transformTo = BRobot.BRobot.TransformTo(travel_target)
speedTo_2 = BRobot.BRobot.SpeedTo(lead_speed)
transformTo_2 = BRobot.BRobot.TransformTo(lead_in_plane)
speedTo_3 = BRobot.BRobot.SpeedTo(milling_speed)
transformTo_3 = BRobot.BRobot.TransformTo(rest_of_toolpath_planes)
speedTo_4 = BRobot.BRobot.SpeedTo(lead_speed_2)
move = BRobot.BRobot.Move(lead_out_vector)
wait = BRobot.BRobot.Wait(watch_4)
combine = List.Combine(create, message, speedTo, transformTo, speedTo_2, transformTo_2, speedTo_3, transformTo_3, speedTo_4, move, wait)
watch_5 = Watch(combine)
flatten_2 = Flatten(combine)

# group: Back to 'home' position
code_block_6 = CodeBlock { 0; 90; }
jointsTo = BRobot.BRobot.JointsTo(code_block_6.out0, code_block_6.out0, code_block_6.out0, code_block_6.out0, code_block_6.out1, code_block_6.out0)

join = List.Join(flatten_2, jointsTo)

# group (continued): Generate, merge and flatten actions
watch_6 = Watch(join)

# group: Create an ABB Robot and compile these actions into a native program
code_block_7 = CodeBlock { "ABB"; }
create_2 = BRobot.BRobot.Create(code_block_7)
exportCode = BRobot.BRobot.ExportCode(create_2, join)
watch_7 = Watch(exportCode)
code_block_8 = CodeBlock { "C:\DynamoBRobot.mod"; }
writeToFile = BRobot.BRobot.WriteToFile(watch_7, code_block_8)
watch_8 = Watch(writeToFile)
code_block_9 = CodeBlock()
# ---------- code_block_9.designscript (3 lines) ----------
"If you are getting error messages writing to a file,";
"Dynamo may not have permission to modify your system.";
"Try running Dynamo as Admin.";
# ----------------------------------------
